vi "student_Wiener_filter.gvi"   [LabVIEW NXG]
inputs:
  "Modulation Parameters In": T6 = {"Modulation Type"="QPSK", "Control Information\nfor Packet Header/Tail"={"Training Sequence (derived)"=[], "Zero Pad Length"=0}, "RX Oversample Factor"=20, "Synchronization Options"={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}, "Number of Data Symbols (Derived)"=100, "RX Sample Rate"=4000000, "Pulse Shaping Parameters"={"Modulation Type"="PSK", "Pulse Shaping Filter"="Root Raised Cos", "Filter Parameter"=0.5, "Filter Length (Symbols)"=8}, "Channel Estimation/Equalization Parameters"={"Equalization Method"="", "Channel Estimate Length"=1, "Equalizer Length"=1, "Equalizer Delay"=-1}}
  "equalizer delay": i32
  "channel estimate": c128[]
  "Equalizer length": i32
  "var_symb": f64
  "var_noise": f64
outputs:
  "Modulation Parameters Out": T6
  "Wiener filter coeff": c128[]
  "MSE": f64
panel indicators:
  "Real part of the Wiener coefficients": f64[]
types:
  T1 = cluster{"Training Sequence (derived)": c128[], "Zero Pad Length": i32}
  T2 = cluster{"Synchronization Method": string, "Fixed Offset": i32, "Symbol Timing Recovery Method": string, "Frame Detection Method": string, "Correct Frequency Offset": bool}
  T3 = enum{"none", "Raised Cosine", "Root Raised Cos", "Gaussian"}
  T4 = cluster{"Modulation Type": enum{"FSK", "PSK", "QAM", "MSK", "PAM", "ASK"}, "Pulse Shaping Filter": T3, "Filter Parameter": f64, "Filter Length (Symbols)": i32}
  T5 = cluster{"Equalization Method": string, "Channel Estimate Length": i32, "Equalizer Length": i32, "Equalizer Delay": i32}
  T6 = cluster{"Modulation Type": string, "Control Information\nfor Packet Header/Tail": T1, "RX Oversample Factor": i32, "Synchronization Options": T2, "Number of Data Symbols (Derived)": i32, "RX Sample Rate": f64, "Pulse Shaping Parameters": T4, "Channel Estimation/Equalization Parameters": T5}
diagram:
  $"Modulation Parameters Out" <- $"Modulation Parameters In"
  # h[-K2] .... h[K1]
  # f[0] .... f[K1+K2]
  call "compute_channel_cross_correlation.gvi"(equalizer delay=$"equalizer delay", channel estimate=$"channel estimate", Equalizer length=$"Equalizer length")
  # Change to the Wiener coeffs
  Complex To Real Imaginary(x + iy=[1+0i]) -> (x=w1)
  $"Real part of the Wiener coefficients" <- w1
  $"Wiener filter coeff" <- [1+0i]
  # To build Toeplitz matrix
  call "Create Special Complex Matrix.gvi"()
  # Solve system
  call "Solve Complex Linear Equations (single right hand).gvi"()
  # Dot product
  call "Complex Dot Product.gvi"()
