vi "student_OFDM_modulator.gvi"   [LabVIEW NXG]
inputs:
  "Input Symbols": c128[]
  "OFDM Parameters In": T1 = {"FFT size (N)"=64, "Length of CP (Lc)"=8, "Null Tones"=[0, 30, 31, 32], "Number of OFDM Symbols (derived)"=1, "Training Sequence FFT size"=0, "Training Sequence Length of CP"=0}
  "error in (no error)": error
outputs:
  "Output Symbols": c128[]
  "OFDM Parameters out": T1
  "error out": error
types:
  T1 = cluster{"FFT size (N)": i32, "Length of CP (Lc)": i32, "Null Tones": u32[], "Number of OFDM Symbols (derived)": i32, "Training Sequence FFT size": i32, "Training Sequence Length of CP": i32}
diagram:
  $"OFDM Parameters out" <- $"OFDM Parameters In"
  Property Node(instance in=$"OFDM Parameters In")
  # COMPLETE HERE
  # Useful blocks:
  call "S2P.gviprotected"()
  call "P2S.gviprotected"()
  call "OFDM_insert_null_tones.gviprotected"()
  call "OFDM_add_CP.gviprotected"()
